# Grasshopper definition AS_Dominic_CelesteVisualizer.gh (Grasshopper 1.0.7)
# plug-ins: Pufferfish, LunchBox, Kangaroo2 Components, Human

max_distance_from_ground_ft = Slider(0.25, range=0.25..3)
crv = Curve([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])
ceiling_height_ft = Slider(8, range=7..12)
list = ValueList({"Less Fixtures": 0, "More Fixtures": 1, "Lots of Fixtures": 2}, selected="Less Fixtures")
list_2 = ValueList({"Outline": 0, "Random Infill": 1, "Grid Infill": 2}, selected="Outline")
item = ListItem(List=crv, Index=Slider(1, range=0..3), Wrap=True)

# ---- group: Input Curve
crv_2 = Curve(item)

# ----
less_more_fixtures = GetNumber(list, AtLeast=0, AtMost=2, Maximum=1.797693135e+308, Minimum=-1.797693135e+308, TreeAccess=False)
chord_distance_from_ground = GetNumber(max_distance_from_ground_ft, AtLeast=0, AtMost=3, Maximum=1.797693135e+308, Minimum=-1.797693135e+308, TreeAccess=False)
ceiling_height = GetNumber(ceiling_height_ft, AtLeast=7, AtMost=12, Maximum=1.797693135e+308, Minimum=-1.797693135e+308, TreeAccess=False)
pattern_type = GetInteger(list_2, AtLeast=0, AtMost=2, Maximum=2147483647, Minimum=-2147483648, TreeAccess=False)
define_path = GetGeometry(crv_2, AtLeast=1, AtMost=1, DeleteInput=False, Filter=1074004029, TreeAccess=False)
pattern = GetNumber(Slider(51, range=0..100), AtLeast=1, AtMost=100, Maximum=1.797693135e+308, Minimum=-1.797693135e+308, TreeAccess=False)

# ---- group: Centers & Scales Input Curve
crv_3 = Curve(define_path)
brec = BoundingRectangle(Geometry=crv_3, Plane=PlaneXY(0, 0, 0), Axis=0, Slide=0, Union=True)  # -> Bounding, DimensionX, DimensionY
area = Area(Geometry=brec.Bounding)  # -> Area, Centroid
move2pt = MoveToPoint(Geometry=crv_3, PointA=area.Centroid, PointB=Point(0, 0, 0))  # -> Moved, Vector, Transform
Z = UnitZ(Factor=expr("x*12", ceiling_height))
move = Move(Geometry=move2pt.Moved, Motion=Z)  # -> Geometry, Transform
previewlw = CustomPreviewLineweights(
    Geometry=move.Geometry,
    Shader=ColourSwatch(SwatchColor=RGB(194, 194, 194)),
    Thickness=Slider(5, range=0..10),
    Absolute=False)

# ---- group: Centers & Scales Input Curve / DO NOT DELETE
cls = Closed(Curve=crv_3)  # -> Closed, Periodic

# ---- group: Creates Grid & Selects Interior Points
offset = OffsetCurve(Curve=move.Geometry, Distance=-2.5, Corners=1)
brec_2 = BoundingRectangle(Geometry=offset, Plane=PlaneXY(0, 0, 0), Axis=0, Slide=0, Union=True)  # -> Bounding, DimensionX, DimensionY
edges = BrepEdges(Brep=brec_2.Bounding)  # -> Naked, Interior, NonManifold
item_2 = ListItem(List=edges.Naked, Index=0, Wrap=True)  # -> Item, Item1
entwine = Entwine(Branch00=item_2.Item, Branch01=item_2.Item1, FlattenInputs=True)
len = Length(Curve=entwine)
bang = ExplodeTree(Data=len)  # -> Branch0, Branch1
division = Division(A=bang.Branch0, B="6.5")
division_2 = Division(A=bang.Branch1, B="6.5")
quads = QuadPanels(Surface=brec_2.Bounding, UDivisions=division, VDivisions=division_2)
area_2 = Area(Geometry=quads)  # -> Area, Centroid
incurve = PointInCurve(Point=area_2.Centroid, Curve=offset)  # -> Relationship, Point
equals = Equality(FirstNumber=incurve.Relationship, SecondNumber=2)  # -> Equality, Inequality
cull = CullPattern(List=quads, CullPattern=equals.Equality)

# ---- group: Creates Grid
brec_3 = BoundingRectangle(Geometry=move.Geometry, Plane=PlaneXY(0, 0, 0), Axis=0, Slide=0, Union=True)  # -> Bounding, DimensionX, DimensionY
edges_2 = BrepEdges(Brep=brec_3.Bounding)  # -> Naked, Interior, NonManifold
entwine_2 = Entwine(Branch00=brec_3.DimensionX, Branch01=brec_3.DimensionY, FlattenInputs=True)
item_3 = ListItem(List=edges_2.Naked, Index=0, Wrap=True)  # -> Item, Item1
division_3 = Division(A=entwine_2, B="9")
round = Round(Number=division_3)  # -> Nearest, Floor, Ceiling
series = Series(Start=0, Step="9", Count=round.Ceiling)
bang_2 = ExplodeTree(Data=simplify(series))  # -> Branch0, Branch1
offset_2 = OffsetCurve(Curve=item_3.Item1, Distance=expr("-x", bang_2.Branch0), Corners=1)  # -> flatten(Curve)
offset_3 = OffsetCurve(Curve=item_3.Item, Distance=expr("-x", bang_2.Branch1), Corners=1)
ccx = CurveCurve(CurveA=offset_2, CurveB=offset_3)  # -> flatten(Points), ParamsA, ParamsB
incurve_2 = PointInCurve(Point=ccx.Points, Curve=move.Geometry)  # -> Relationship, Point
equals_2 = Equality(FirstNumber=incurve_2.Relationship, SecondNumber=2)  # -> Equality, Inequality
cull_2 = CullPattern(List=ccx.Points, CullPattern=equals_2.Equality)

# ---- group: Randomly Culls ~25% of Points
area_3 = Area(Geometry=cull)  # -> Area, Centroid
scale = Scale(Geometry=cull, Center=area_3.Centroid, Factor=0.5)  # -> Geometry, Transform
lng = ListLength(List=scale.Geometry)
series_2 = Series(Start=0, Step=1, Count=lng)
pop2d = Populate2D(Region=scale.Geometry, Count=1, Seed=series_2)  # -> flatten(Population)
lng_2 = ListLength(List=flatten(pop2d))
multiplication = Multiplication(A=lng_2, B=0.8)
random = Random(Range=lng_2, Number=multiplication, Seed=pattern)
round_2 = Round(Number=random)  # -> Nearest, Floor, Ceiling
cset = CreateSet(List=round_2.Nearest)  # -> Set, Map
cull_i = CullIndex(List=flatten(pop2d), Indices=cset.Set, Wrap=True)

# ----
random_2 = Random(Range=Domain(0, 1), Number=1, Seed=pattern)
seam = Seam(Curve=reparameterize(move.Geometry), Seam=random_2)
random_3 = Random(Range=Domain(6.5, 12), Number=1, Seed=pattern)
divlength = DivideLength(Curve=seam, Length=random_3)  # -> Points, Tangents, Parameters
cull_i_2 = CullIndex(List=divlength.Points, Indices=0, Wrap=True)

expression = Expression(x=cls.Closed, y=pattern_type, z="0", Expression="If(x=False, z, y)")
filter = StreamFilter(Gate=expression, Stream0=cull_i_2, Stream1=cull_i, Stream2=cull_2)

# ---- group: Cables
subtraction = Subtraction(A=ceiling_height, B=chord_distance_from_ground)
dom = ConstructDomain(DomainStart=expr("x*0.5", ceiling_height), DomainEnd=subtraction)
lng_3 = ListLength(List=flatten(filter))
random_4 = Random(Range=dom, Number=lng_3, Seed=pattern)
round_3 = Round(Number=random_4)  # -> Nearest, Floor, Ceiling
line = LineSDL(Start=filter, Direction="0,0,-1", Length=expr("x*12", round_3.Floor))
mp = MultiPipe(Curves=graft(line), NodeSize=0.05, EndOffset=1, StrutSize=1, Segment=0, KinkAngle=0.6, CubeFit=0, Caps=0)
meshsubd = MeshFromSubD(SubD=mp, Density=2)
demesh = DeconstructMesh(Mesh=meshsubd)  # -> Vertices, Faces, Colours, Normals
conmesh = ConstructMesh(Vertices=demesh.Vertices, Faces=demesh.Faces, Colours=ColourSwatch(SwatchColor=RGB(28, 28, 28)))
context_bake = ContextBake(Geometry=conmesh)

# ----
panel = Panel("""1 to 2
2 to 3
2 to 5""")
item_4 = ListItem(List=panel, Index=less_more_fixtures, Wrap=True)

# ---- group: Orients Glass Diffusers
lng_4 = ListLength(List=line)
random_5 = Random(Range=item_4, Number=lng_4, Seed=2)
divide = DivideCurve(Curve=line, Count=random_5, Kinks=False)  # -> Points, Tangents, Parameters
cull_i_3 = CullIndex(List=divide.Points, Indices=0, Wrap=True)
mesh = Mesh(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)
area_4 = Area(Geometry=mesh)  # -> Area, Centroid
move2pt_2 = MoveToPoint(Geometry=mesh, PointA=area_4.Centroid, PointB=flatten(cull_i_3))  # -> Moved, Vector, Transform
demesh_2 = DeconstructMesh(Mesh=move2pt_2.Moved)  # -> Vertices, Faces, Colours, Normals
conmesh_2 = ConstructMesh(Vertices=demesh_2.Vertices, Faces=demesh_2.Faces, Colours=ColourSwatch(SwatchColor=RGBA(145, 145, 145, 219)))
context_bake_2 = ContextBake(Geometry=conmesh_2)

# ---- group: Orient Body Housing
mesh_2 = Mesh(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)
area_5 = Area(Geometry=mesh_2)  # -> Area, Centroid
move2pt_3 = MoveToPoint(Geometry=mesh_2, PointA=area_5.Centroid, PointB=flatten(cull_i_3))  # -> Moved, Vector, Transform
demesh_3 = DeconstructMesh(Mesh=move2pt_3.Moved)  # -> Vertices, Faces, Colours, Normals
conmesh_3 = ConstructMesh(Vertices=demesh_3.Vertices, Faces=demesh_3.Faces, Colours=ColourSwatch(SwatchColor=RGB(64, 64, 64)))
context_bake_3 = ContextBake(Geometry=conmesh_3)
